# Grasshopper definition morphingmatterbeadstool.gh (Grasshopper 1.0.7)
# plug-ins: Weaverbird, MeshEdit Components, Kangaroo Components, Shortest Walk in Gh, Human UI, Kangaroo2 Components, Millipede, Pufferfish, Human

toggle = CreateToggle(Default=True, Label="Preview Branch Shape")
list = ValueList({"Center Point": 1, "Custom Point": 0}, selected="Custom Point")
values = ValueListener(Elements=toggle, SomeProperty=True)  # -> Values, Indices
md_slider = CreateMultidimensionalSlider()
pickbtn = CreateRhinoPickButton(
    ButtonName="Select Outline Curve",
    Prompt="Please select geometry...",
    AllowMultiple=True,
    AllowNone=True,
    Type=0,
    ButtonStyle=0)

# ---- group: US Letter Paper
panel = Panel("215.9")
dom = ConstructDomain(DomainStart=expr("-x/2", "279.4"), DomainEnd=expr("x/2", "279.4"))
dom_2 = ConstructDomain(DomainStart=expr("-x/2", panel), DomainEnd=expr("x/2", panel))
rectangle = Rectangle(Plane=PlaneXY(0, 0, 0), XSize=dom_2, YSize=dom, Radius=0)  # -> Rectangle, Length

# ----
values_2 = ValueListener(Elements=md_slider, SomeProperty=True)  # -> Values, Indices
values_3 = ValueListener(Elements=pickbtn, SomeProperty=True)  # -> Values, Indices
textbox = CreateTextBox(Label="Random Seed (0~100)", DefaultText="20", UpdateButton=False, showLabel=True)
textbox_2 = CreateTextBox(Label="Group (2~6)", DefaultText="3", UpdateButton=False, showLabel=True)
textbox_3 = CreateTextBox(Label="Density (50~300)", DefaultText="100", UpdateButton=False, showLabel=True)
toggle_2 = BooleanToggle(False)  # disabled
panel_2 = Panel("Confirm Branch Thickness")  # disabled
geo = Geometry(values_3.Values)
toggle_3 = BooleanToggle(False)  # disabled
values_4 = ValueListener(Elements=textbox, SomeProperty=True)  # -> Values, Indices
values_5 = ValueListener(Elements=textbox_3, SomeProperty=True)  # -> Values, Indices
values_6 = ValueListener(Elements=textbox_2, SomeProperty=True)  # -> Values, Indices
checkbox = CreateCheckbox(Label=panel_2, StartingValue=toggle_2)  # disabled
density = Slider(100, range=0..1000)
group = Slider(2, range=0..10)
panel_3 = Panel("Confirm Outline Curve")  # disabled
random_seed = Slider(20, range=0..100)
crv = Curve(geo)
crv_2 = Curve(rectangle.Rectangle)
textbox_4 = CreateTextBox(Label="Branch Width (2~12)", DefaultText="5", UpdateButton=False, showLabel=True)
textbox_5 = CreateTextBox(Label="Tip Roundness (2~8)", DefaultText="8", UpdateButton=False, showLabel=True)
disc = Discontinuity(Curve=crv_2, Level=1)  # -> Points, Parameters
values_7 = ValueListener(Elements=checkbox, SomeProperty=True)  # -> Values, Indices; disabled
checkbox_2 = CreateCheckbox(Label=panel_3, StartingValue=toggle_3)  # disabled
boundary = BoundarySurfaces(Edges=crv)
pulldown = CreatePulldownMenu(Label="Define Root Point", ListItems=list, showLabel=True)
preview = CustomPreview(
    Geometry=crv_2,
    Material={diffuse=RGB(221, 160, 221), emission=RGB(66, 48, 66), shine=0.5, specular=RGB(255, 255, 255), transparency=0})
values_8 = ValueListener(Elements=textbox_4, SomeProperty=True)  # -> Values, Indices
values_9 = ValueListener(Elements=textbox_5, SomeProperty=True)  # -> Values, Indices
item = ListItem(List=disc.Points, Index=3, Wrap=True)
values_10 = ValueListener(Elements=checkbox_2, SomeProperty=True)  # -> Values, Indices; disabled
srf = Surface(boundary)
area = Area(Geometry=srf)  # -> Area, Centroid
Y = UnitY(Factor=expr("-x", Slider(9, range=0..100)))
values_11 = ValueListener(Elements=pulldown, SomeProperty=True)  # -> Values, Indices
X = UnitX(Factor=Slider(28, range=0..100))
launchxpwin = LaunchTransparentWindow(Show=Toggle(True), Name="Beads Tool", Width="300", Height="800", ChildStatus=0, EnableHorizScroll=False)
number_slider = Slider(3.6, range=3..5)
button = CreateButton(ButtonName="Visualize Changes", ButtonStyle=0)
pickbtn_2 = CreateRhinoPickButton(
    ButtonName="Select Anchor Points",
    Prompt="Please select geometry...",
    AllowMultiple=True,
    AllowNone=True,
    Type=0,
    ButtonStyle=0)
popgeo = PopulateGeometry(Geometry=srf, Count=values_5.Values, Seed=values_4.Values)
addition = Addition(A=X, B=Y)
move = Move(Geometry=item, Motion=addition)  # -> Geometry, Transform
pickbtn_3 = CreateRhinoPickButton(
    ButtonName="Select Substrate",
    Prompt="Please select geometry...",
    AllowMultiple=True,
    AllowNone=True,
    Type=0,
    ButtonStyle=0)
pickbtn_4 = CreateRhinoPickButton(
    ButtonName="Select Beads Placement Curves (UP)",
    Prompt="Please select geometry...",
    AllowMultiple=True,
    AllowNone=True,
    Type=0,
    ButtonStyle=0)
pickbtn_5 = CreateRhinoPickButton(
    ButtonName="Select Beads Placement Curves (DOWN)",
    Prompt="Please select geometry...",
    AllowMultiple=True,
    AllowNone=True,
    Type=0,
    ButtonStyle=0)
textbox_6 = CreateTextBox(Label="Beads Distance (4~10)", DefaultText="5", UpdateButton=False, showLabel=True)
values_12 = ValueListener(Elements=pickbtn_2, SomeProperty=True)  # -> Values, Indices
pan = Panel("Bake Substrate Boundary")
values_13 = ValueListener(Elements=button, SomeProperty=True)  # -> Values, Indices
adjustelem = AdjustElementAppearance(ElementsToAdjust=pickbtn_4, Foreground=RGB(0, 0, 0), Background=ColourSwatch(SwatchColor=RGB(255, 158, 158)))
expander = CreateExpander(UIElements=pickbtn, Header="Select Outline Curve", Open=True)
tag = TextTag(Location=move.Geometry, Text="US Letter")
values_14 = ValueListener(Elements=pickbtn_3, SomeProperty=True)  # -> Values, Indices
values_15 = ValueListener(Elements=pickbtn_4, SomeProperty=True)  # -> Values, Indices
adjustelem_2 = AdjustElementAppearance(ElementsToAdjust=pickbtn_5, Background=ColourSwatch(SwatchColor=RGB(158, 213, 255)))
values_16 = ValueListener(Elements=textbox_6, SomeProperty=True)  # -> Values, Indices
values_17 = ValueListener(Elements=pickbtn_5, SomeProperty=True)  # -> Values, Indices
adjustelem_3 = AdjustElementAppearance(ElementsToAdjust=pickbtn_2, Background=ColourSwatch(SwatchColor=RGB(255, 242, 158)))
evalsrf = EvaluateSurface(Surface=reparameterize(srf), Point=values_2.Values)  # -> Point, Normal, UDirection, VDirection, Frame
geo_2 = Geometry(values_12.Values)
adjustelem_4 = AdjustElementAppearance(ElementsToAdjust=button, Foreground=RGB(0, 0, 0), Background=ColourSwatch(SwatchColor=RGB(224, 224, 224)))
geo_3 = Geometry(values_14.Values)

pan_2 = Panel("some intro text XXXXXXXXXXXXXXXXXXXXXXXXXXXXXXXXXXXXXXXXXXXXXXXXXXXXXXXXXXXXXXXXXXXXXXXXXXXXXXXXXXXXXXXXXXXXXXXXXXXXXXXXXXXXXXXXXXXXXX")
tb = CreateTextBlock(Text=pan_2, TextSize=12, Justification=0)
pan_3 = Panel("Instruction")

geo_4 = Geometry(values_15.Values)
crv_3 = Curve(geo_4)
previewlw = CustomPreviewLineweights(Geometry=crv_3, Shader=ColourSwatch(SwatchColor=RGB(255, 0, 0)), Thickness=Slider(3, range=0..10), Absolute=False)
len = Length(Curve=crv_3)
dots = DotDisplay(Point=geo_2, Colour=ColourSwatch(SwatchColor=RGB(255, 220, 43)), Size=Slider(2, range=0..10))
integer_division = IntegerDivision(A=len, B=values_16.Values)
geo_5 = Geometry(values_17.Values)
crv_4 = Curve(geo_5)
previewlw_2 = CustomPreviewLineweights(Geometry=crv_4, Shader=ColourSwatch(SwatchColor=RGB(0, 30, 255)), Thickness=Slider(3, range=0..10), Absolute=False)
len_2 = Length(Curve=crv_4)
integer_division_2 = IntegerDivision(A=len_2, B=values_16.Values)
divide = DivideCurve(Curve=crv_4, Count=integer_division_2, Kinks=False)  # -> Points, Tangents, Parameters
divide_2 = DivideCurve(Curve=crv_3, Count=integer_division, Kinks=False)  # -> Points, Tangents, Parameters
edges = BrepEdges(Brep=geo_3)  # -> Naked, Interior, NonManifold
merge = Merge(Data1=textbox_4, Data2=textbox_5, Data3=checkbox)  # -> flatten(Result)
pline = PolyLine(Vertices=divide.Points, Closed=False)
pline_2 = PolyLine(Vertices=divide_2.Points, Closed=False)
eval = Evaluate(F="(x+1)/2", x=values_16.Values)

pt = Point(geo_2)
plasticanchor = PlasticAnchor(Point=pt, Limit=1, Strength=Slider(100, range=0..100), Reset=False)

pt_2 = Point(evalsrf.Point)
pt_3 = Point(flatten(pt_2))
merge_2 = Merge(Data1=flatten(area.Centroid), Data2=flatten(pt_3))  # -> flatten(Result)
item_2 = ListItem(List=merge_2, Index=values_11.Indices, Wrap=True)
pt_4 = Point(item_2)

# ---- group: Network / Root
pt_5 = Point(pt_4)

# ----
gate = StreamGate(Stream=pt_5, Gate=values.Values)  # -> Target0, Target1
pt_6 = Point(gate.Target1)

# ---- group: Network
prox = Proximity2D(Points=flatten([pt_5, popgeo]), Plane=PlaneXY(0, 0, 0), Group=values_6.Values)  # -> flatten(Links), Topology
ln = Line(StartPoint=pt_5, EndPoint=popgeo)
dupln = RemoveDuplicateLines(Lines=prox.Links, Tolerance=0.01)
shortwalk = ShortestWalk(Curves=dupln, WantedPath=ln)  # -> ShortestWalk, Succession, Direction, Length
explode = Explode(Curve=shortwalk.ShortestWalk, Recursive=True)  # -> flatten(Segments), Vertices
dupln_2 = RemoveDuplicateLines(Lines=explode.Segments, Tolerance=0.01)

# ----
button_2 = CreateButton(ButtonName=pan, ButtonStyle=0)
values_18 = ValueListener(Elements=button_2, SomeProperty=True)  # -> Values, Indices
join = JoinCurves(Curves=edges.Naked, Preserve=False)
panel_4 = Panel("""-1
1""")
button_3 = CreateButton(ButtonName="Replay", ButtonStyle=0)
panel_5 = Panel("""-1
1""")
explode_2 = Explode(Curve=simplify(pline), Recursive=True)  # -> simplify(Segments), Vertices
explode_3 = Explode(Curve=simplify(pline_2), Recursive=True)  # -> simplify(Segments), Vertices
button_4 = CreateButton(ButtonName="Pause", ButtonStyle=0)
button_5 = CreateButton(ButtonName="Run", ButtonStyle=0)
button_6 = CreateButton(ButtonName="Confirm Placement", ButtonStyle=0)
toggle_4 = CreateToggle(Default=False, Label="Simulation")
crv_5 = Curve(join)
expander_2 = CreateExpander(UIElements=button_2, Header=pan, Open=True)
multiplication = Multiplication(A=Slider(1, range=0..1), B=panel_4)
merge_3 = Merge(Data1=explode_2.Segments)
multiplication_2 = Multiplication(A=Slider(1, range=0..1), B=panel_5)
values_19 = ValueListener(Elements=button_4, SomeProperty=True)  # -> Values, Indices
values_20 = ValueListener(Elements=button_5, SomeProperty=True)  # -> Values, Indices
values_21 = ValueListener(Elements=button_6, SomeProperty=True)  # -> Values, Indices
values_22 = ValueListener(Elements=toggle_4, SomeProperty=True)  # -> Values, Indices
values_23 = ValueListener(Elements=button_3, SomeProperty=True)  # -> Values, Indices
merge_4 = Merge(Data1=pickbtn_5, Data2=pickbtn_4, Data3=textbox_6, Data4=pickbtn_3, Data5=pickbtn_2, Data6=button)  # -> flatten(Result)
offset = OffsetCurve(Curve=flatten(explode_2.Segments), Distance=graft(multiplication), Plane=PlaneXY(0, 0, 0), Corners=1)  # -> simplify(Curve)
offset_2 = OffsetCurve(Curve=flatten(explode_3.Segments), Distance=graft(multiplication_2), Plane=PlaneXY(0, 0, 0), Corners=1)  # -> simplify(Curve)
expander_3 = CreateExpander(UIElements=merge, Header="Add Thickness", Open=True)
null = NullPlaceholder()
toggle_5 = BooleanToggle(False)  # disabled
merge_5 = Merge(Data1=toggle_4, Data2=button_3)  # -> flatten(Result)
toggle_6 = BooleanToggle(False)  # disabled
panel_6 = Panel("Confirm Branches")  # disabled
explode_4 = Explode(Curve=offset, Recursive=True)  # -> Segments, Vertices
layers = CreateModifyLayers(
    LayerName="Substrate Surface",
    LayerColor=ColourSwatch(SwatchColor=RGB(255, 255, 255)),
    DeleteLayer=False,
    enableFullPath=False)  # -> LayerNames, LayerFullPath
explode_5 = Explode(Curve=offset_2, Recursive=True)  # -> Segments, Vertices
panel_7 = Panel("Confirm Root Point")  # disabled
pan_4 = Panel("""Preset
Branch
Kirigami
Simulator""")
merge_6 = Merge(Data1=plasticanchor, Data2=null)  # -> flatten(Result)
pt_7 = Point(pt_4)

# ---- group: Tree
crv_6 = Curve(dupln_2)

# ----
gate_2 = StreamGate(Stream=crv_6, Gate=values.Values)  # -> Target0, Target1
crv_7 = Curve(gate_2.Target1)
path_mapper = PathMapper(explode_4.Segments, source="{A;B;C}(i)", target="{B}(A)")
path_mapper_2 = PathMapper(explode_5.Segments, source="{A;B;C}(i)", target="{B}(A)")
checkbox_3 = CreateCheckbox(Label=panel_6, StartingValue=toggle_5)  # disabled
multiplication_3 = Multiplication(A=eval, B="-1")
checkbox_4 = CreateCheckbox(Label=panel_7, StartingValue=toggle_6)  # disabled
merge_7 = Merge(Data1=pulldown, Data2=md_slider, Data3=checkbox_4, Data4=textbox_3, Data5=textbox, Data6=textbox_2, Data7=checkbox_3)  # -> flatten(Result)
expander_4 = CreateExpander(UIElements=merge_7, Header="Generate Branches", Open=True)
merge_8 = Merge(Data1=toggle, Data2=expander, Data3=expander_4, Data4=expander_3, Data5=expander_2)
multiplication_4 = Multiplication(A=eval, B="1")
expander_5 = CreateExpander(UIElements=button_6, Header="File Output", Open=True)
createatts = CreateAttributes(LayerName=layers.LayerNames, enableFullPath=False)
expander_6 = CreateExpander(UIElements=merge_4, Header="Beads Placement", Open=True)
null_2 = NullItem(Item=merge_6)  # -> NullFlags, InvalidFlags, Description
dispatch = Dispatch(List=merge_6, DispatchPattern=null_2.NullFlags)  # -> ListA, ListB
number_slider_2 = Slider(6, range=0..20)
number_slider_3 = Slider(6, range=0..20)
values_24 = ValueListener(Elements=checkbox_3, SomeProperty=True)  # -> Values, Indices; disabled
values_25 = ValueListener(Elements=checkbox_4, SomeProperty=True)  # -> Values, Indices; disabled
stack = CreateStack(UIElements=merge_8, Horizontal=False)
loft = Loft(Curves=path_mapper, Options={Adjust=False, Closed=False, LoftEnds=0, LoftSimp=0, LoftType=0, Rebuild=10, Refit=0.01})  # -> flatten(Loft)
Z = UnitZ(Factor=multiplication_3)
loft_2 = Loft(Curves=path_mapper_2, Options={Adjust=False, Closed=False, LoftEnds=0, LoftSimp=0, LoftType=0, Rebuild=10, Refit=0.01})  # -> flatten(Loft)
Z_2 = UnitZ(Factor=multiplication_4)
panel_8 = Panel(path_mapper)

# ---- group: Branches sizes / ROOT
root = Point(pt_7)

# ----
expander_7 = CreateExpander(UIElements=merge_5, Header="Simulation", Open=True)
dispatch_2 = Dispatch(List=crv_6, DispatchPattern=values_24.Values)  # -> ListA, ListB; disabled
dispatch_3 = Dispatch(List=pt_4, DispatchPattern=values_25.Values)  # -> ListA, ListB; disabled
merge_9 = Merge(Data1=expander_6, Data2=expander_7, Data3=expander_5)
geo_6 = Geometry(dispatch_2.ListB)  # disabled
debrep = DeconstructBrep(Brep=loft_2)  # -> Faces, Edges, Vertices
geo_7 = Geometry(dispatch_3.ListB)  # disabled
debrep_2 = DeconstructBrep(Brep=loft)  # -> Faces, Edges, Vertices
area_2 = Area(Geometry=loft)  # -> Area, Centroid
move_2 = Move(Geometry=area_2.Centroid, Motion=Z)  # -> Geometry, Transform
area_3 = Area(Geometry=loft_2)  # -> Area, Centroid
move_3 = Move(Geometry=area_3.Centroid, Motion=Z_2)  # -> Geometry, Transform
flip = FlipMatrix(Data=debrep_2.Vertices)
flip_2 = FlipMatrix(Data=debrep.Vertices)
explode_6 = Explode(Curve=debrep_2.Edges, Recursive=True)  # -> Segments, Vertices
explode_7 = Explode(Curve=debrep.Edges, Recursive=True)  # -> Segments, Vertices
ln_2 = Line(StartPoint=area_2.Centroid, EndPoint=flip)
ln_3 = Line(StartPoint=area_3.Centroid, EndPoint=flip_2)
merge_10 = Merge(Data1=explode_6.Segments, Data2=explode_7.Segments)
ln_4 = Line(StartPoint=move_3.Geometry, EndPoint=flip_2)
dupln_3 = RemoveDuplicateLines(Lines=flatten(merge_10), Tolerance=0.01)
ln_5 = Line(StartPoint=move_2.Geometry, EndPoint=flip)
wbweave = WeaverbirdsMeshFromLinesWeaveBack(Lines=dupln_3, MaximumValence=4)
demesh = DeconstructMesh(Mesh=wbweave)  # -> Vertices, Faces, Colours, Normals
srf_2 = Surface(geo_3)
merge_11 = Merge(Data1=ln_5, Data2=ln_4)
length_line = LengthLine(Line=merge_11, Strength=10)
collider = Collider(Objects=move_2.Geometry, Radii=eval, Strength=Slider(6, range=0..100))
discretization = Discretization(Breps=srf_2, Points=demesh.Vertices, Tolerance=0.001, MeshSize=Slider(1.5, range=1..3), Iterations=500, Beta=1.414213562)  # -> Meshes, Curves
mesh = Mesh(discretization.Meshes)
merge_12 = Merge(Data1=area_2.Centroid, Data2=area_3.Centroid)
medges = MeshEdges(Mesh=mesh)  # -> NakedEdges, InteriorEdges, NonManifoldEdges
pt_8 = Point(merge_12)

# ----
# Adjust Window Properties
# You can edit the window properties - choose a theme, an accent color, a background color, and position it relative to screen coordinates. You can even show or hide the title bar, although hiding it can make the window difficult to drag around.
# 
# Note that for the accent color list, you can simply right-click the component and choose "Create Accent List" for a pre-populated pulldown including the allowed accent colors.
accent_colors = ValueList({"Amber", "Blue", "Brown", "Cobalt", "Crimson", "Cyan", "Emerald", "Green", "Indigo", "Lime", "Magenta", "Mauve", "Olive", "Orange", "Pink", "Purple", "Red", "Sienna", "Steel", "Taupe", "Teal", "Violet", "Yellow"}, selected="Violet")
swatch = White(SwatchColor=RGB(255, 255, 255))

meshcp = MeshClosestPoint(Point=pt_8, Mesh=mesh)  # -> Point, Index, Parameter
rod = Rod(Polyline=pline, LengthFactor=1, AngleFactor="0", AxialStrength=10, BendStrength=Slider(0, range=0..1))
edgelengths = EdgeLengths(Mesh=mesh, LengthFactor=1, Strength=1)
smooth = Smooth(M=mesh, Strength=1)
show = Show(G=mesh)
show_2 = Show(G=meshcp.Point)
winprops = SetWindowProperties(
    Window=launchxpwin,
    Theme=Toggle(False),
    AccentColor=accent_colors,
    ShowTitleBar=Toggle(True),
    BackgroundColor=swatch,
    ScaleFactor=1)
entwine = Entwine(
    Branch00=show,
    Branch01=edgelengths,
    Branch02=smooth,
    Branch03=collider,
    Branch04=length_line,
    Branch05=dispatch.ListB,
    Branch06=show_2,
    FlattenInputs=True)
button_7 = CreateButton(ButtonName="Bake Preset Shape", ButtonStyle=0)
values_26 = ValueListener(Elements=button_7, SomeProperty=True)  # -> Values, Indices
solver = Solver(GoalObjects=entwine, Reset=[values_23.Values, values_13.Values], Threshold=1e-15, Tolerance=0.01, On=values_22.Values)  # -> I, V, simplify(O)
expander_8 = CreateExpander(UIElements=button_7, Header="Bake Preset Shape", Open=True)
bouncysolver = BouncySolver(
    GoalObjects=entwine,
    Reset=values_23.Values,
    Threshold=1e-15,
    Tolerance=0.0001,
    Damping=0.99,
    Iterations=Slider(1548, range=0..3000),
    On=values_22.Values)  # -> I, V, O; disabled
X_2 = UnitX(Factor=panel)
unflatten = UnflattenTree(Tree=bouncysolver.O, Guide=entwine)  # -> simplify(Tree)
branch = TreeBranch(Tree=solver.O, Path="{4}", MaintainPaths=True)
branch_2 = TreeBranch(Tree=solver.O, Path="{6}", MaintainPaths=True)
branch_3 = TreeBranch(Tree=solver.O, Path="{0}", MaintainPaths=True)
move_4 = Move(Geometry=flatten([crv_2, crv_5]), Motion=X_2)  # -> Geometry, Transform
panel_9 = Panel("""Helix
3 Branches
Grid
6 Branches
2 sides Grid
Square kirigami
Ring double sides
Ring
Circular Kirigami
Coral
Kirigami""")
rec = DataRecorder(unflatten, DataLimit=-10, RecordData=True)
wbcatmullclark = WeaverbirdsCatmullClarkSubdivision(MeshCurves=branch_3, Level=3, SmoothNakedEdges=1)
pt_9 = Point(branch_2)
medges_2 = MeshEdges(Mesh=branch_3)  # -> NakedEdges, InteriorEdges, NonManifoldEdges
end = EndPoints(Curve=branch)  # -> Start, End
unflatten_2 = UnflattenTree(Tree=pt_9, Guide=explode_2.Segments)
srf_3 = Surface(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)
srf_4 = Surface(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)
srf_5 = Surface(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)
srf_6 = Surface(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)
srf_7 = Surface(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)
srf_8 = Surface(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)
srf_9 = Surface(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)
srf_10 = Surface(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)
srf_11 = Surface(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)
srf_12 = Surface(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)
srf_13 = Surface(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)
createatts_2 = CreateAttributes(LayerName="Default", enableFullPath=False)
item_3 = ListItem(List=rec, Index=-1, Wrap=True)
preview_2 = CustomPreview(Geometry=wbcatmullclark, Material=ColourSwatch(SwatchColor=RGBA(255, 255, 255, 142)))
pt_10 = Point(end.Start)
intcrv = Interpolate(Vertices=unflatten_2, Degree=3, Periodic=False, KnotStyle=1)  # -> Curve, Length, Domain
merge_13 = Merge(
    Data1=srf_5,
    Data2=srf_6,
    Data3=srf_7,
    Data4=srf_8,
    Data5=srf_9,
    Data6=srf_10,
    Data7=srf_11,
    Data8=srf_12,
    Data9=srf_13,
    Data10=srf_4,
    Data11=srf_3)
listbox = CreateListBox(ListItems=panel_9, SelectedIndex=0, Height=100)
expander_9 = CreateExpander(UIElements=listbox, Header="Select Preset Shape", Open=True)
duppt = RemoveDuplicatePts(Points=pt_10, Tolerance=0.01)
toggle_7 = CreateToggle(Default=True, Label="Preview Preset Shape")
crv_8 = Curve([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])
crv_9 = Curve([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])
crv_10 = Curve([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])
crv_11 = Curve([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])
crv_12 = Curve([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])
crv_13 = Curve(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)
crv_14 = Curve([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])
crv_15 = Curve([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])
crv_16 = Curve([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])
crv_17 = Curve([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])
crv_18 = Curve(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)
bake = BakeGeometry(Bake=values_21.Values, Geometry=move_4.Geometry, Attributes=createatts_2, DeleteOldBakes=False, PreserveTrees=False)
crv_19 = Curve(intcrv.Curve)
values_27 = ValueListener(Elements=listbox, SomeProperty=True)  # -> Values, Indices
item_4 = ListItem(List=merge_13, Index=values_27.Indices, Wrap=True)
crvgraph = CurvatureGraph(Curve=intcrv.Curve, Density=5, Scale=Slider(110, range=0..1000))
group_2 = Group(Objects=crv_16)
group_3 = Group(Objects=crv_8)
group_4 = Group(Objects=crv_9)
group_5 = Group(Objects=crv_17)
group_6 = Group(Objects=crv_10)
group_7 = Group(Objects=crv_11)
group_8 = Group(Objects=crv_12)
group_9 = Group(Objects=crv_13)
group_10 = Group(Objects=crv_14)
group_11 = Group(Objects=crv_15)
group_12 = Group(Objects=crv_18)
values_28 = ValueListener(Elements=toggle_7, SomeProperty=True)  # -> Values, Indices
pt_11 = Point(area_2.Centroid)
merge_14 = Merge(Data1=toggle_7, Data2=expander_9, Data3=expander_8)
cloud = CloudDisplay(Points=duppt, Colours=ColourSwatch(SwatchColor=RGB(165, 71, 237)), Size=expr("x*1.5", eval), SpriteType=0)
cir = Circle(Plane=pt_11, Radius=1)
merge_15 = Merge(
    Data1=group_2,
    Data2=group_3,
    Data3=group_4,
    Data4=group_5,
    Data5=group_6,
    Data6=group_7,
    Data7=group_8,
    Data8=group_9,
    Data9=group_10,
    Data10=group_11,
    Data11=group_12)
item_5 = ListItem(List=merge_15, Index=values_27.Indices, Wrap=True)
panel_10 = Panel("Beads Alignment Curves (DOWN)")
transform = Transform(Geometry=cir, Transform=move_4.Transform)
null_3 = NullPlaceholder()
null_4 = NullPlaceholder()
null_5 = NullPlaceholder()
null_6 = NullPlaceholder()
crv_20 = Curve([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])
crv_21 = Curve([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])
crv_22 = Curve([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])
crv_23 = Curve([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])
null_7 = NullPlaceholder()
null_8 = NullPlaceholder()
null_9 = NullPlaceholder()
layers_2 = CreateModifyLayers(LayerName=panel_10, LayerColor=ColourSwatch(SwatchColor=RGB(46, 178, 255)), DeleteLayer=False, enableFullPath=False)  # -> LayerNames, LayerFullPath
gate_3 = StreamGate(Stream=item_4, Gate=values_28.Values)  # -> Target0, Target1
group_13 = Group(Objects=null_3)
group_14 = Group(Objects=null_4)
group_15 = Group(Objects=null_6)
group_16 = Group(Objects=crv_20)
group_17 = Group(Objects=null_5)
group_18 = Group(Objects=crv_21)
group_19 = Group(Objects=crv_22)
group_20 = Group(Objects=crv_23)
group_21 = Group(Objects=null_7)
group_22 = Group(Objects=null_8)
group_23 = Group(Objects=null_9)
layers_3 = CreateModifyLayers(
    LayerName="Substrate Surface",
    LayerColor=ColourSwatch(SwatchColor=RGB(255, 255, 255)),
    DeleteLayer=False,
    enableFullPath=False)  # -> LayerNames, LayerFullPath
createatts_3 = CreateAttributes(LayerName=panel_10, GroupIndices="21", enableFullPath=False)
ungroup = Ungroup(Group=item_5)
gate_4 = StreamGate(Stream=ungroup, Gate=values_28.Values)  # -> Target0, Target1
preview_3 = CustomPreview(
    Geometry=gate_3.Target1,
    Material={diffuse=RGB(221, 160, 221), emission=RGB(66, 48, 66), shine=0.5, specular=RGB(255, 255, 255), transparency=0})
createatts_4 = CreateAttributes(LayerName=layers_3.LayerNames, enableFullPath=False)
merge_16 = Merge(
    Data1=group_13,
    Data2=group_14,
    Data3=group_17,
    Data4=group_15,
    Data5=group_16,
    Data6=group_18,
    Data7=group_19,
    Data8=group_21,
    Data9=group_20,
    Data10=group_23,
    Data11=group_22)
item_6 = ListItem(List=merge_16, Index=values_27.Indices, Wrap=True)
bake_2 = BakeGeometry(Bake=values_21.Values, Geometry=transform, Attributes=createatts_3, DeleteOldBakes=False, PreserveTrees=False)
ungroup_2 = Ungroup(Group=item_6)
gate_5 = StreamGate(Stream=ungroup_2, Gate=values_28.Values)  # -> Target0, Target1
pt_12 = Point(area_3.Centroid)
bake_3 = BakeGeometry(Bake=values_26.Values, Geometry=item_4, Attributes=createatts_4, DeleteOldBakes=False, PreserveTrees=False)
cir_2 = Circle(Plane=pt_12, Radius=1)
transform_2 = Transform(Geometry=cir_2, Transform=move_4.Transform)
pt_13 = Point([Point(38.74535466, 2.249283408, 0), Point(37.94907501, 4.871906774, 0), Point(33.43272453, 4.531766833, 0), Point(31.57145111, 0.0249126127, 0), Point(-6.763170603, 4.616801818, 0), Point(-12.56170625, 3.68141698, 0), Point(-13.15695115, -1.335647152, 0)])
pt_14 = Point([Point(36.4833433, 134.8218933, 0), Point(-26.51365864, 134.5780154, 0), Point(-24.96764271, -127.6607178, 0), Point(35.46201075, -125.0420918, 0)])
null_10 = NullPlaceholder()
null_11 = NullPlaceholder()
null_12 = NullPlaceholder()
null_13 = NullPlaceholder()
null_14 = NullPlaceholder()
null_15 = NullPlaceholder()
null_16 = NullPlaceholder()
null_17 = NullPlaceholder()
null_18 = NullPlaceholder()
group_24 = Group(Objects=null_10)
group_25 = Group(Objects=null_11)
group_26 = Group(Objects=null_12)
group_27 = Group(Objects=null_13)
group_28 = Group(Objects=null_14)
group_29 = Group(Objects=null_15)
group_30 = Group(Objects=null_16)
group_31 = Group(Objects=null_17)
group_32 = Group(Objects=null_18)
group_33 = Group(Objects=pt_14)
group_34 = Group(Objects=pt_13)
swatch_2 = ColourSwatch(SwatchColor=RGB(46, 178, 255))
preview_4 = CustomPreview(Geometry=gate_4.Target1, Material=swatch_2)
layers_4 = CreateModifyLayers(
    LayerName="Beads Alignment Curves (UP)",
    LayerColor=ColourSwatch(SwatchColor=RGB(255, 46, 46)),
    DeleteLayer=False,
    enableFullPath=False)  # -> LayerNames, LayerFullPath
merge_17 = Merge(
    Data1=group_24,
    Data2=group_25,
    Data3=group_26,
    Data4=group_27,
    Data5=group_28,
    Data6=group_29,
    Data7=group_30,
    Data8=group_32,
    Data9=group_34,
    Data10=group_31,
    Data11=group_33)
createatts_5 = CreateAttributes(LayerName=layers_4.LayerNames, GroupIndices="22", enableFullPath=False)
layers_5 = CreateModifyLayers(LayerName="Beads Alignment Curves (DOWN)", LayerColor=swatch_2, DeleteLayer=False, enableFullPath=False)  # -> LayerNames, LayerFullPath
item_7 = ListItem(List=merge_17, Index=values_27.Indices, Wrap=True)
createatts_6 = CreateAttributes(LayerName=layers_5.LayerNames, GroupIndices="11", enableFullPath=False)
bake_4 = BakeGeometry(Bake=values_21.Values, Geometry=transform_2, Attributes=createatts_5, DeleteOldBakes=False, PreserveTrees=False)
ungroup_3 = Ungroup(Group=item_7)
gate_6 = StreamGate(Stream=ungroup_3, Gate=values_28.Values)  # -> Target0, Target1
bake_5 = BakeGeometry(Bake=values_26.Values, Geometry=ungroup, Attributes=createatts_6, DeleteOldBakes=False, PreserveTrees=False)
swatch_3 = ColourSwatch(SwatchColor=RGB(255, 46, 46))
preview_5 = CustomPreview(Geometry=gate_5.Target1, Material=swatch_3)
layers_6 = CreateModifyLayers(
    LayerName="Anchor Points",
    LayerColor=ColourSwatch(SwatchColor=RGB(255, 46, 178)),
    DeleteLayer=False,
    enableFullPath=False)  # -> LayerNames, LayerFullPath
pickbtn_6 = CreateRhinoPickButton(ButtonName="Select Cuts", Prompt="Please select geometry...", AllowMultiple=True, AllowNone=True, Type=0, ButtonStyle=0)
pickbtn_7 = CreateRhinoPickButton(
    ButtonName="Select Outline Curve",
    Prompt="Please select geometry...",
    AllowMultiple=True,
    AllowNone=True,
    Type=0,
    ButtonStyle=0)
cuts_density = Slider(4, range=0..10)
cuts_distance = Slider(4.22, range=0..10)
cuts_number = Slider(4, range=0..20)
cuts_gap = Slider(0.87, range=0..1)
gap_adjustment = Slider(9.84, range=0..20)
layers_7 = CreateModifyLayers(LayerName="Beads Alignment Curves (UP)", LayerColor=swatch_3, DeleteLayer=False, enableFullPath=False)  # -> LayerNames, LayerFullPath
createatts_7 = CreateAttributes(LayerName=layers_6.LayerNames, GroupIndices="23", enableFullPath=False)
values_29 = ValueListener(Elements=pickbtn_6, SomeProperty=True)  # -> Values, Indices
values_30 = ValueListener(Elements=pickbtn_7, SomeProperty=True)  # -> Values, Indices
createatts_8 = CreateAttributes(LayerName=layers_7.LayerNames, GroupIndices="12", enableFullPath=False)
slider = CreateSlider(Slider=cuts_distance, ShowBounds=False, ShowTicks=False, ShowTooltip=False, ShowValLabel=True, showLabel=True)
slider_2 = CreateSlider(Slider=cuts_number, ShowBounds=False, ShowTicks=False, ShowTooltip=False, ShowValLabel=True, showLabel=True)
slider_3 = CreateSlider(Slider=cuts_density, ShowBounds=False, ShowTicks=False, ShowTooltip=False, ShowValLabel=True, showLabel=True)
geo_8 = Geometry(values_29.Values)
crv_24 = Curve(graft(geo_8))
geo_9 = Geometry(values_30.Values)
slider_4 = CreateSlider(Slider=gap_adjustment, ShowBounds=False, ShowTicks=False, ShowTooltip=False, ShowValLabel=True, showLabel=True)
bake_6 = BakeGeometry(Bake=values_21.Values, Attributes=createatts_7, DeleteOldBakes=False, PreserveTrees=False)
values_31 = ValueListener(Elements=slider, SomeProperty=True)  # -> Values, Indices
values_32 = ValueListener(Elements=slider_2, SomeProperty=True)  # -> Values, Indices
slider_5 = CreateSlider(Slider=cuts_gap, ShowBounds=False, ShowTicks=False, ShowTooltip=False, ShowValLabel=True, showLabel=True)
values_33 = ValueListener(Elements=slider_3, SomeProperty=True)  # -> Values, Indices
values_34 = ValueListener(Elements=slider_4, SomeProperty=True)  # -> Values, Indices
bake_7 = BakeGeometry(Bake=values_26.Values, Geometry=ungroup_2, Attributes=createatts_8, DeleteOldBakes=False, PreserveTrees=False)
values_35 = ValueListener(Elements=slider_5, SomeProperty=True)  # -> Values, Indices
series = Series(Start=0, Step=values_31.Values, Count=values_32.Values)
crv_25 = Curve(geo_9)
offset_3 = OffsetCurve(Curve=crv_24, Distance=expr("-x", series), Plane=PlaneXY(0, 0, 0), Corners=Slider(3, range=0..10))
dispatch_4 = Dispatch(List=flatten(offset_3), DispatchPattern=[True, False])  # -> ListA, graft(ListB)
len_3 = Length(Curve=dispatch_4.ListB)
swatch_4 = ColourSwatch(SwatchColor=RGB(255, 46, 178))
preview_6 = CustomPreview(Geometry=gate_6.Target1, Material=swatch_4)
merge_18 = Merge(Data1=pickbtn_7, Data2=pickbtn_6, Data3=slider_5, Data4=slider_3, Data5=slider, Data6=slider_2, Data7=slider_4)
crv_26 = Curve(graft(dispatch_4.ListA))
len_4 = Length(Curve=crv_26)
division = Division(A=len_4, B=values_33.Values)
layers_8 = CreateModifyLayers(LayerName="Anchor Points", LayerColor=swatch_4, DeleteLayer=False, enableFullPath=False)  # -> LayerNames, LayerFullPath
division_2 = Division(A=len_3, B=values_33.Values)
subtraction = Subtraction(A="1", B=values_35.Values)
multiplication_5 = Multiplication(A=division, B=values_35.Values)
multiplication_6 = Multiplication(A=division, B=subtraction)
createatts_9 = CreateAttributes(LayerName=layers_8.LayerNames, GroupIndices="14", enableFullPath=False)
expander_10 = CreateExpander(UIElements=merge_18, Header="Kirigami Generator", Open=True)
subtraction_2 = Subtraction(A="1", B=values_35.Values)
merge_19 = Merge(Data1=multiplication_5, Data2=multiplication_6)
multiplication_7 = Multiplication(A=division_2, B=values_35.Values)
bake_8 = BakeGeometry(Bake=values_26.Values, Geometry=ungroup_3, Attributes=createatts_9, DeleteOldBakes=False, PreserveTrees=False)
multiplication_8 = Multiplication(A=division_2, B=subtraction_2)
dash = DashPattern(Curve=crv_26, Pattern=merge_19)  # -> Dashes, Gaps
addition_2 = Addition(A=multiplication_7, B=values_34.Values)
merge_20 = Merge(Data1=addition_2, Data2=multiplication_8)
split = SplitList(List=dash.Dashes, Index=values_33.Values)  # -> ListA, ListB
dash_2 = DashPattern(Curve=dispatch_4.ListB, Pattern=merge_20)  # -> Dashes, Gaps
split_2 = SplitList(List=dash_2.Dashes, Index=values_33.Values)  # -> ListA, ListB
merge_21 = Merge(Data1=simplify(split.ListA), Data2=simplify(split_2.ListA))  # -> flatten(Result)
number_slider_4 = Slider(1, range=0..1)
crv_27 = Curve(graft(merge_21))
offset_4 = OffsetCurve(Curve=crv_27, Distance=expr("-1", number_slider_4), Corners=1)
offset_5 = OffsetCurve(Curve=crv_27, Distance=number_slider_4, Corners=1)
button_8 = CreateButton(ButtonName="Bake Kirigami Surface", ButtonStyle=0)
loft_3 = Loft(
    Curves=[offset_5, offset_4],
    Options={Adjust=False, Closed=False, LoftEnds=0, LoftSimp=0, LoftType=0, Rebuild=10, Refit=0.01})
edges_2 = BrepEdges(Brep=loft_3)  # -> Naked, Interior, NonManifold
values_36 = ValueListener(Elements=button_8, SomeProperty=True)  # -> Values, Indices
toggle_8 = CreateToggle(Default=True, Label="Preview Kirigami Shape")
join_2 = JoinCurves(Curves=edges_2.Naked, Preserve=False)  # -> flatten(Curves)
srfsplit = SurfaceSplit(Surface=crv_25, Curves=flatten(join_2))
area_4 = Area(Geometry=srfsplit)  # -> Area, Centroid
sort = SortList(Keys=area_4.Area, ValuesA=srfsplit)  # -> Keys, ValuesA
item_8 = ListItem(List=sort.ValuesA, Index=-1, Wrap=True)
srf_14 = Surface(item_8)
expander_11 = CreateExpander(UIElements=button_8, Header="Bake Kirigami Surface", Open=True)
values_37 = ValueListener(Elements=toggle_8, SomeProperty=True)  # -> Values, Indices
gate_7 = StreamGate(Stream=srf_14, Gate=values_37.Values)  # -> Target0, Target1
merge_22 = Merge(Data1=toggle_8, Data2=expander_10, Data3=expander_11)
tabs = TabbedView(
    TabNames=pan_4,
    TabTextSize=Slider(16, range=0..100),
    Tab0=flatten(merge_14),
    Tab1=flatten(stack),
    Tab2=flatten(merge_22),
    Tab3=flatten(merge_9))
stack_2 = CreateStack(UIElements=tabs, Horizontal=True)
addelems = AddElements(Window=launchxpwin, Elements=flatten(stack_2), DoVLChecking=True)  # -> AddedElements, ElementNames
preview_7 = CustomPreview(Geometry=gate_7.Target1, Material=ColourSwatch(SwatchColor=RGB(255, 255, 255)))
layers_9 = CreateModifyLayers(
    LayerName="Substrate Surface",
    LayerColor=ColourSwatch(SwatchColor=RGB(255, 255, 255)),
    DeleteLayer=False,
    enableFullPath=False)  # -> LayerNames, LayerFullPath
createatts_10 = CreateAttributes(LayerName=layers_9.LayerNames, enableFullPath=False)
bake_9 = BakeGeometry(Bake=values_36.Values, Geometry=srf_14, Attributes=createatts_10, DeleteOldBakes=False, PreserveTrees=False)

# ---- group: Branches sizes
feet_roundness = Slider(40, range=-170..180)
number_slider_5 = Slider(4, range=1..10)
toggle_9 = BooleanToggle(True)
power_for_branch_size = Slider(5, range=1..20)
number_slider_6 = Slider(6, range=1..10)
lines = Curve(crv_6)
c_script = CSharpScript(lineList=lines, toleranceLines=0.1, point=root, pow=power_for_branch_size)  # -> out, P, LP, PP, PL, R; inputs lineList: list of Line, toleranceLines: Double, point: Point3d, pow: Double
# ---------- c_script: C# ----------
    //OUT data
    List<Point3d> nodeCenters = new List<Point3d>();
    DataTree<int> lineVertex = new DataTree<int>();
    DataTree<int> vertexVertexes = new DataTree<int>();
    DataTree<int> vertexLine = new DataTree<int>();

    ///BEGIN TEST INPUTS
    if (_lineList == null) return;

    if (_lineList.Count < 2)
    {
      this.Component.AddRuntimeMessage(GH_RuntimeMessageLevel.Error, "There must be more than 1 line");
      return;
    }
    LineTopology(_lineList, _toleranceLines, ref nodeCenters, ref  lineVertex, ref vertexVertexes, ref vertexLine);

    List < double > listRadius = new List < double > ();
    List<Point3d> newPoints = new List<Point3d>();
    List<Polyline> polylines = new List<Polyline>();

    Radius(_point, _pow, nodeCenters, lineVertex, vertexVertexes, vertexLine, ref listRadius, ref newPoints, ref polylines);


    //We need to put radius at the know position of the topology
    List < double > listRadiusOrdered = new List < double > ();
    for (int i = 0; i < nodeCenters.Count; i++)
    {
      listRadiusOrdered.Add(0.0);
    }
    double maxRadius = 0.0;
    for (int j = 0; j < listRadius.Count; j++)
    {
      if (listRadius[j] > maxRadius)
      {
        maxRadius = listRadius[j];
      }
    }
    for (int i = 0; i < nodeCenters.Count; i++)
    {
      for (int j = 0; j < listRadius.Count; j++)
      {
        if (newPoints[j].DistanceTo(nodeCenters[i]) < 0.0001)
        {
          listRadiusOrdered[i] = listRadius[j] / maxRadius;
        }
      }
    }

    P = nodeCenters;
    LP = lineVertex;
    PP = vertexVertexes;
    PL = vertexLine;
    R = listRadiusOrdered;
# ---------- c_script: C# additional code ----------
  // <Custom additional code>
  //Thic function replicate SandBox lines topology
  //As inputs there are lines
  //Tolerance is used to glued points thar are close to each others
  //Outputs are
  //points list of Point3d
  //linePoint dataTree containing the points index number for end and beginning of the line
  //pointPoint dataTree containing the points index number for each other point connected to this point
  //pointLine dataTree containing the line index connecting a point
  public static void LineTopology(List < Line > lines, double tolerance, ref List<Point3d> points, ref DataTree<int> linePoint, ref DataTree<int> pointPoint, ref DataTree<int>  pointLine)
  {
    for (int n_line = 0; n_line < lines.Count; n_line++)
    {
      bool addPoint = true;
      int nPoint = 0;
      for (int i = 0; i < points.Count; i++)
      {
        if (points[i].DistanceTo(lines[n_line].From) < tolerance)
        {
          addPoint = false;
          nPoint = i;
        }
      }
      if (addPoint)
      {
        points.Add(lines[n_line].From);
        linePoint.Add(points.Count - 1, new GH_Path(n_line));
      }
      else
      {
        linePoint.Add(nPoint, new GH_Path(n_line));
      }

      addPoint = true;
      for (int i = 0; i < points.Count; i++)
      {
        if (points[i].DistanceTo(lines[n_line].To) < tolerance)
        {
          addPoint = false;
          nPoint = i;
        }
      }
      if (addPoint)
      {
        points.Add(lines[n_line].To);
        linePoint.Add(points.Count - 1, new GH_Path(n_line));
      }
      else
      {
        linePoint.Add(nPoint, new GH_Path(n_line));
      }
    }
    for (int n_line = 0; n_line < linePoint.BranchCount; n_line++)
    {
      pointPoint.Add(linePoint.Branches[n_line][0], new GH_Path(linePoint.Branches[n_line][1]));
      pointPoint.Add(linePoint.Branches[n_line][1], new GH_Path(linePoint.Branches[n_line][0]));
    }
    for (int j = 0; j < linePoint.BranchCount; j++)
    {
      pointLine.Add(j, new GH_Path(linePoint.Branch(j)[0]));
      pointLine.Add(j, new GH_Path(linePoint.Branch(j)[1]));
    }
  }

  public static void Radius(Point3d rootPoint, double power, List<Point3d> points, DataTree<int> linePoint, DataTree<int> pointPoint, DataTree<int>  pointLine, ref List<double> listRadius, ref  List<Point3d> pointsNew, ref List<Polyline> polylines)
  {
    double distBuffer = 10000000;
    int iroot = 0;
    for (int i = 0; i < points.Count; i++)
    {
      if (rootPoint.DistanceTo(points[i]) < distBuffer)
      {
        distBuffer = rootPoint.DistanceTo(points[i]);
        iroot = i;
      }
    }
    List<int> list0 = new List<int>();
    List<int> list1 = new List<int>();

    for (int branch = 0; branch < linePoint.BranchCount ; branch++)
    {
      list0.Add(linePoint.Branches[branch][0]);
      list1.Add(linePoint.Branches[branch][1]);
    }

    Leaf leaf = new Leaf(points[iroot]);

    List<int> parents = new List<int>();
    parents.Add(iroot);
    List<Vein> veinsParents = new List<Vein>();
    veinsParents.Add(leaf.root);

    int index = 1;
    while ((list0.Count > 0) && index < 200000)
    {
      index += 1;
      iroot = parents[0];
      parents.RemoveAt(0);

      Vein veinParent = veinsParents[0];
      veinsParents.RemoveAt(0);

      //For all lines/branches that are still there
      int sizeList = (list0.Count - 1);
      for (int branch = sizeList; branch >= 0 ; branch--)
      {
        //If there is a line having a commont root
        if ((list0[branch] == iroot) || (list1[branch] == iroot))
        {
          //We seek children number
          int nchild;
          if ((list0[branch] == iroot)) {nchild = list1[branch];}
          else{nchild = list0[branch];}

          //We create a new vein
          Vein veinNew = new  Vein(points[nchild], veinParent, Vector3d.ZAxis);
          leaf.AddVein(veinNew);

          //If this point is not an end
          if (pointPoint.Branches[nchild].Count > 1)
          {
            parents.Add(nchild);
            veinsParents.Add(veinNew);
          }

          // MessageBox.Show("linePoint.BranchCount 1= " + linePoint.BranchCount + " branch" + branch);
          //linePoint.RemovePath(new GH_Path(branch));

          //MessageBox.Show("remove " + list0[branch] + "<->" + list1[branch] + "  count= " + list0.Count);

          list0.RemoveAt(branch);
          list1.RemoveAt(branch);

          //  MessageBox.Show("linePoint.BranchCount afeter remove = " + linePoint.BranchCount);
        }
      }
    }
    //radiusOfVeins(Leaf leaf, double radiusMin, double power, ref List<Point3d> points, ref List<Polyline> polylines, ref List<double> listRadius)
    radiusOfVeins(leaf, 1.0, power, ref pointsNew, ref  polylines, ref  listRadius);


  }
  ///End lineTopology
  /////////////////////////////////////////////////////
  ////////////////////////////////////////////////////////////
  public class Leaf
  {
    public List<Vein> veins;
    public Vein root;

    public Leaf(Point3d pt)
    {
      root = new Vein(pt);
      veins = new List<Vein>();
      veins.Add(root);
    }

    public void AddVein(Vein vein)
    {
      if (vein != null) veins.Add(vein);
    }
    public void Clear()
    {
      veins.Clear();
    }
  }
  ////////////////////////////////////////////////////////////
  public class Vein
  {
    public double radius;
    public Point3d position;
    public Vector3d direction; //RNG
    public bool active;//RNG
    public bool addVein;//RNG
    public bool isEnd;
    public Vein parent;
    public List<Vein> childs = new List<Vein>();

    public Vein(Point3d point)
    {
      active = true;//RNG
      addVein = false;//RNG
      isEnd = true;
      radius = -1;
      position = point;
      direction = new Vector3d(0, 0, 0);
      parent = null;
    }
    public Vein(Point3d point, Vein newParent, Vector3d dir)
    {
      active = true;//RNG
      addVein = false;//RNG
      isEnd = true;
      radius = -1;
      position = point;
      direction = dir;
      parent = newParent;
      newParent.AddChild(this);
    }

    public void AddChild(Vein childVein)
    {
      childs.Add(childVein);
      isEnd = false;
    }
  }

  static void radiusOfVeins(Leaf leaf, double radiusMin, double power, ref List<Point3d> points, ref List<Polyline> polylines, ref List<double> listRadius)
  {
    //////////////////RADIUS of BRANCHES////////////////////////
    List<Point3d> pointsForPolyline = new List<Point3d>();
    Vein veinNext, veinUpper;
    veinUpper = null;
    int n_runs;
    bool test, doWhile;
    double oldRadius = 0.0;

    veinNext = leaf.veins[0];
    n_runs = 0;
    doWhile = true;
    // while ( (veinNext.radius < 0.0))
    while ((n_runs < 1000000) && doWhile)
    {
      n_runs += 1;
      if (veinNext.isEnd)
      {
        veinNext.radius = radiusMin;
        points.Add(veinNext.position);
        listRadius.Add(veinNext.radius);

        oldRadius = veinNext.radius;
        pointsForPolyline.Add(veinNext.position);
        veinNext = veinNext.parent; //WE GO DOWN
        pointsForPolyline.Add(veinNext.position);
      }
      else
      {
        test = true;
        for (int jj = 0; jj < veinNext.childs.Count(); jj++)
        {
          if (veinNext.childs[jj].radius < 0)
          {
            test = false;
            veinUpper = veinNext.childs[jj];
          }
        }
        if (test)
        {
          veinNext.radius = 0.0;
          for (int hh = 0; hh < veinNext.childs.Count(); hh++)
          {
            veinNext.radius += Math.Pow(veinNext.childs[hh].radius, power);
          }
          veinNext.radius = Math.Pow(veinNext.radius, 1 / power);
          points.Add(veinNext.position);
          listRadius.Add(veinNext.radius);

          if (veinNext.parent != null)
          {
            oldRadius = veinNext.radius;//////////////////
            pointsForPolyline.Add(veinNext.position); /////////////////

            points.Add(veinNext.position); /////////////////
            listRadius.Add(veinNext.radius);

            veinNext = veinNext.parent; ////WE GO DOWN
            if (veinNext.childs.Count() > 1)
            {
              polylines.Add(new Polyline(pointsForPolyline));
              pointsForPolyline.Clear();
            }
          }
          else
          {
            doWhile = false;
          }
        }
        else
        {
          veinNext = veinUpper;  ////WE GO UP
          //listRadius.Add(oldRadius);
          polylines.Add(new Polyline(pointsForPolyline));
          pointsForPolyline.Clear();
        }
      }
    }
    ///////////////////////////////////
  }
  ////////////////////////////////////////////////////
# ---------- end c_script ----------
item_9 = ListItem(List=c_script.LP, Index=0, Wrap=True)  # -> Item, Item1
multiplication_9 = Multiplication(A=c_script.R, B=values_8.Values)
multiplication_10 = Multiplication(A=c_script.R, B=values_8.Values)
multiplication_11 = Multiplication(A=c_script.R, B=values_8.Values)
circle = CircleCNR(Center=c_script.P, Normal=Vector(0, 0, 1), Radius=multiplication_11)
rad = Radians(Degrees=feet_roundness)

item_10 = ListItem(List=c_script.P, Index=item_9.Item, Wrap=True)
item_11 = ListItem(List=c_script.P, Index=item_9.Item1, Wrap=True)

item_12 = ListItem(List=multiplication_10, Index=item_9.Item, Wrap=True)  # -> flatten(Item)
item_13 = ListItem(List=multiplication_9, Index=item_9.Item1, Wrap=True)  # -> flatten(Item)

ln_6 = Line(StartPoint=item_10, EndPoint=item_11)  # -> flatten(Line)

# ---- group: Envelop curves
c_script_2 = CSharpScript(
    lines_in=flatten(ln_6),
    tolerance=0.01,
    width_b=flatten(item_12),
    width_e=flatten(item_13),
    deviation=values_9.Values,
    angle=rad,
    n_u=number_slider_6,
    n_v=number_slider_5,
    zbool=toggle_9)  # -> out, P, LP, PP, PL, lines, ends, connect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; inputs lines_in: list of Line, tolerance: Double, width_b: list of Double, width_e: list of Double, deviation: Double, angle: Double, n_u: Int32, n_v: Int32, zbool: Boolean
# ---------- c_script_2: C# ----------
    //v02
    //Add variable width per lines
    //V03
    //Suppression of limitation in number of run of the while
    //Test of n_u and n_v in order to be no less than 2
    //

    //OUT data
    List<Point3d> points = new List<Point3d>();
    DataTree<int> lineVertex = new DataTree<int>();
    DataTree<int> vertexVertexes = new DataTree<int>();
    DataTree<int> vertexLine = new DataTree<int>();

    List<Line> linesOut = new List<Line>();
    DataTree<Line> linesBranch = new DataTree<Line>();
    bool isEnd;
    List<Line> linesEnd = new List<Line>();

    List<LDPanel> panels = new List<LDPanel>();
    double width_calc = 0.0;

    ///BEGIN TEST INPUTS
    if (lines_in == null) return;

    if (lines_in.Count < 1)
    {
      this.Component.AddRuntimeMessage(GH_RuntimeMessageLevel.Error, "There must be more than 1 line");
      return;
    }
    LineTopology(lines_in, tolerance, ref points, ref  lineVertex, ref vertexVertexes, ref vertexLine);

    //v0.2
    if (width_b.Count < lines_in.Count)
    {
      int size_width = width_b.Count;

      for (int i = size_width; i <= lines_in.Count; i++)
      {
        width_b.Add(width_b[size_width - 1]);
      }
    }

    if (width_e.Count < lines_in.Count)
    {
      int size_width = width_e.Count;

      for (int i = size_width; i <= lines_in.Count; i++)
      {
        width_e.Add(width_e[size_width - 1]);
      }
    }
    //v0.2
    if (n_u < 2) n_u = 2;
    if (n_v < 2) n_v = 2;

    //For all lines
    for (int i = 0; i < lineVertex.BranchCount; i++)
    {
      Line lineOut = new Line();
      LDSide side1 = new LDSide();
      LDSide side2 = new LDSide();

      //One side of the line
      lineOut = LinePerp(points, lineVertex, vertexVertexes, true, true, i, width_b, width_e, out isEnd, out width_calc);
      if (isEnd) linesEnd.Add(lineOut);
      linesBranch.Add(lineOut, new GH_Path(i * 2));
      side1 = new LDSide(lineVertex.Branch(i)[1], points[lineVertex.Branch(i)[1]], lineOut.Direction, isEnd, width_calc);

      lineOut = LinePerp(points, lineVertex, vertexVertexes, false, false, i, width_b, width_e, out isEnd, out width_calc);
      if (isEnd) linesEnd.Add(lineOut);
      linesBranch.Add(lineOut, new GH_Path(i * 2));
      side2 = new LDSide(lineVertex.Branch(i)[0], points[lineVertex.Branch(i)[0]], lineOut.Direction, isEnd, width_calc);
      panels.Add(new LDPanel(side1, side2, i));

      //Other side of the line
      lineOut = LinePerp(points, lineVertex, vertexVertexes, false, true, i, width_b, width_e, out isEnd, out width_calc);
      if (isEnd) linesEnd.Add(lineOut);
      linesBranch.Add(lineOut, new GH_Path(i * 2 + 1));
      side1 = new LDSide(lineVertex.Branch(i)[0], points[lineVertex.Branch(i)[0]], lineOut.Direction, isEnd, width_calc);

      lineOut = LinePerp(points, lineVertex, vertexVertexes, true, false, i, width_b, width_e, out isEnd, out width_calc);
      if (isEnd) linesEnd.Add(lineOut);
      linesBranch.Add(lineOut, new GH_Path(i * 2 + 1));
      side2 = new LDSide(lineVertex.Branch(i)[1], points[lineVertex.Branch(i)[1]], lineOut.Direction, isEnd, width_calc);
      panels.Add(new LDPanel(side1, side2, i));
    }

    DataTree<LDPanel> treePanels = new DataTree<LDPanel>();
    DataTree<int> treeInt = new DataTree<int>();

    int test = 0;
    int branch = 0;
    while (panels.Count > 0)
    {
      treePanels.Add(panels[0], new GH_Path(branch));
      treeInt.Add(panels[0].lineNumber, new GH_Path(branch));
      panels.RemoveAt(0);

      int intersections = 0;
      do
      {
        List<LDPanel> intPanels = GetIntersections(treePanels.Branch(branch), panels);
        intersections = intPanels.Count;
        for (int i = (intPanels.Count - 1); i >= 0; i--)
        {
          treePanels.Add(intPanels[i], new GH_Path(branch));
          treeInt.Add(intPanels[i].lineNumber, new GH_Path(branch));
          panels.Remove(intPanels[i]);
        }
      } while (intersections > 0);
      test += 1;
      branch += 1;
    }
    DataTree<Brep> brepTree = new DataTree<Brep>();

    for (int i = 0; i < treePanels.BranchCount; i++)
    {
      for (int j = 0; j < treePanels.Branch(i).Count; j++)
      {
        brepTree.Add(treePanels.Branch(i)[j].ToBrep(), new GH_Path(i));
      }
    }
    DataTree<Mesh> meshTree = new DataTree<Mesh>();
    List<Point3d> fixedPoints = new List<Point3d>();
    DataTree<LineCurve> listUCurves = new DataTree<LineCurve> ();
    DataTree<LineCurve> listVCurves = new DataTree<LineCurve> ();

    for (int i = 0; i < treePanels.BranchCount; i++)
    {
      for (int j = 0; j < treePanels.Branch(i).Count; j++)
      {
        //meshTree.Add(treePanels.Branch(i)[j].ToMesh(n_u, n_v, angle, width_b[0], ref fixedPoints, ref listUCurves, ref  listVCurves, deviation, zbool), new GH_Path(i));
        meshTree.Add(treePanels.Branch(i)[j].ToMesh(n_u, n_v, angle, ref fixedPoints, ref listUCurves, ref  listVCurves, deviation, zbool), new GH_Path(i));
      }
    }
    P = points;
    LP = lineVertex;
    PP = vertexVertexes;
    PL = vertexLine;
    lines = linesBranch;
    ends = linesEnd;
    connect = treeInt;
    brep = brepTree;
    M = meshTree;
    F = fixedPoints;
    U = listUCurves;
    V = listVCurves;
# ---------- c_script_2: C# additional code ----------
  //For points begin and end, representing a line, search the width
  public double getWidthAtBeginning(int begin, int end, DataTree<int> lineVertex, List<double> w_b, List<double> w_e)
  {
    double output = w_b[0];

    for (int i = 0; i < lineVertex.BranchCount; i++)
    {
      if ((lineVertex.Branches[i][0] == begin) && (lineVertex.Branches[i][1] == end))
      {
        output = w_b[i];
        break;
      }
      if ((lineVertex.Branches[i][0] == end) && (lineVertex.Branches[i][1] == begin))
      {
        output = w_e[i];
        break;
      }
    }
    return output;
  }

  //Calculate on the line i, some curve perpandicular if it is an end or mediane if connection with othe lines
  // bool one is used to know if we begin from the firs point (beginning) of line or second (end)
  public Line LinePerp(List<Point3d> points, DataTree<int> lineVertex, DataTree<int> vertexVertexes, bool one, bool two, int i, List<double> width_b, List<double> width_e, out bool isEnd, out double width_calc)
  {
    int i0, i1;
    double signe = 1.0;
    double width;
    if (one)
    {
      i0 = 0;
      i1 = 1;
      width = width_e[i];
    }
    else
    {
      i0 = 1;
      i1 = 0;
      width = width_b[i];
    }

    if (two)
    {
      signe = 1.0;
    }
    else
    {
      signe = -1.0;
    }

    Vector3d dirPerp2 = new Vector3d();
    //Direction of the line
    Vector3d dir = (Vector3d) (points[lineVertex.Branch(i)[i1]] - points[lineVertex.Branch(i)[i0]]);
    //One direction perpendicular of the line, depending on signe sign
    Vector3d dirPerp = Vector3d.CrossProduct(dir, signe * Vector3d.ZAxis);
    dirPerp.Unitize();

    double angleTampon;
    double angle = 10.0;
    double width_buffer = width;
    angle = angle * signe;
    //More than one branch
    if (vertexVertexes.Branch(lineVertex.Branch(i)[i1]).Count > 1)
    {
      isEnd = false;
      //For all points connected to the points at the end of the line (end could be a beginning !)
      for (int j = 0; j < vertexVertexes.Branch(lineVertex.Branch(i)[i1]).Count; j++)
      {
        //If it is not the same line
        if (vertexVertexes.Branch(lineVertex.Branch(i)[i1])[j] != lineVertex.Branch(i)[i0])
        {
          Vector3d dir2 = (Vector3d) (points[vertexVertexes.Branch(lineVertex.Branch(i)[i1])[j]] - points[lineVertex.Branch(i)[i1]]);
          Vector3d dirPerp2Tampon = Vector3d.CrossProduct(dir2, signe * Vector3d.ZAxis);
          dirPerp2Tampon.Unitize();

          //Line connected as 2 points :
          // vertexVertexes.Branch(lineVertex.Branch(i)[i1])[j]
          // lineVertex.Branch(i)[i1]
          angleTampon = Angle(dirPerp2Tampon, dirPerp);
          if (signe > 0)
          {
            if (angleTampon < angle)
            {
              angle = angleTampon;
              dirPerp2 = dirPerp2Tampon;
              width_buffer = getWidthAtBeginning(lineVertex.Branch(i)[i1], vertexVertexes.Branch(lineVertex.Branch(i)[i1])[j], lineVertex, width_b, width_e);
            }
          }
          else
          {
            if ( angleTampon > angle)
            {
              angle = angleTampon;
              dirPerp2 = dirPerp2Tampon;
              width_buffer = getWidthAtBeginning(lineVertex.Branch(i)[i1], vertexVertexes.Branch(lineVertex.Branch(i)[i1])[j], lineVertex, width_b, width_e);
            }
          }
        }
      }
    }
      //Line as an End
    else
    {
      isEnd = true;
      angle = 0.0;
      dirPerp2 = dirPerp;
    }
    width = width + width_buffer;
    width = width / 2;
    width_calc = width;
    if (width / (2.0 * Math.Cos(angle / 2) * Math.Cos(angle / 2)) > 100)
    {
      return new Line(points[lineVertex.Branch(i)[i1]], points[lineVertex.Branch(i)[i1]] - width * (dirPerp + dirPerp2));
    }
    else
      return new Line(points[lineVertex.Branch(i)[i1]], points[lineVertex.Branch(i)[i1]] - width * (dirPerp + dirPerp2) / (2.0 * Math.Cos(angle / 2) * Math.Cos(angle / 2)));
  }


  //This function replicate SandBox lines topology
  //As inputs there are lines
  //Tolerance is used to glued points thar are close to each others
  //Outputs are
  //points list of Point3d
  //linePoint dataTree containing the points index number for end and beginning of the line
  //pointPoint dataTree containing the points index number for each other point connected to this point
  public static void LineTopology(List < Line > lines, double tolerance, ref List<Point3d> points, ref DataTree<int> linePoint, ref DataTree<int> pointPoint, ref  DataTree<int> pointLine)
  {
    for (int n_line = 0; n_line < lines.Count; n_line++)
    {
      bool addPoint = true;
      int nPoint = 0;
      for (int i = 0; i < points.Count; i++)
      {
        if (points[i].DistanceTo(lines[n_line].From) < tolerance)
        {
          addPoint = false;
          nPoint = i;
        }
      }
      if (addPoint)
      {
        points.Add(lines[n_line].From);
        linePoint.Add(points.Count - 1, new GH_Path(n_line));
      }
      else
      {
        linePoint.Add(nPoint, new GH_Path(n_line));
      }

      addPoint = true;
      for (int i = 0; i < points.Count; i++)
      {
        if (points[i].DistanceTo(lines[n_line].To) < tolerance)
        {
          addPoint = false;
          nPoint = i;
        }
      }
      if (addPoint)
      {
        points.Add(lines[n_line].To);
        linePoint.Add(points.Count - 1, new GH_Path(n_line));
      }
      else
      {
        linePoint.Add(nPoint, new GH_Path(n_line));
      }
    }
    for (int n_line = 0; n_line < linePoint.BranchCount; n_line++)
    {
      pointPoint.Add(linePoint.Branches[n_line][0], new GH_Path(linePoint.Branches[n_line][1]));
      pointPoint.Add(linePoint.Branches[n_line][1], new GH_Path(linePoint.Branches[n_line][0]));
    }

    for (int j = 0; j < linePoint.BranchCount; j++)
    {
      pointLine.Add(j, new GH_Path(linePoint.Branch(j)[0]));
      pointLine.Add(j, new GH_Path(linePoint.Branch(j)[1]));
    }

  }
  ///End lineTopology

  public static double Angle(Vector3d v1, Vector3d v2)
  {
    double output = -10;
    v1.Unitize();
    v2.Unitize();
    double g1 = Math.Acos(Math.Max(Math.Min(v1 * v2, 1.0), -1.0));
    Vector3d cross = Vector3d.CrossProduct(v1, v2);
    double g2 = Math.Asin(Math.Max(Math.Min(cross.Z, 1.0), -1.0));

    if (g2 >= 0)
    {
      output = g1;
    }

    else
    {
      if (g1 >= 0)
      {
        output = 2 * Math.PI - g1;
      }
      else
      {
        output = g2 + Math.PI;
      }
    }
    if (output > Math.PI) output = output - 2 * Math.PI;
    return (output % Math.PI);
  }
  ///////////////////////////
  public class LDPanel
  {
    public LDSide side1;
    public LDSide side2;
    public int lineNumber;

    public List<int> ToList()
    {
      List<int> output = new List<int>();
      output.Add(side1.nodeNumber);
      output.Add(side2.nodeNumber);
      output.Add(lineNumber);
      return output;
    }
    public Brep ToBrep()
    {
      List<Curve> curves = new List<Curve>();
      curves.Add(side1.ToCurve());
      curves.Add(side2.ToCurve());
      // Brep[] output = Brep.CreateFromLoft(curves, side1.point, side2.point, LoftType.Normal, false);
      Brep[] output = Brep.CreateFromLoft(curves, Point3d.Unset, Point3d.Unset, LoftType.Normal, false);

      if (output.Length > 0) return output[0];
      else return null;
    }

    //With LIST
    //public Mesh ToMesh(int nu, int nv, double angle, double radius, ref List<Point3d> fixedPoints, ref List<LineCurve> listUCurves, ref List<LineCurve> listVCurves, double deviation, bool zbool)
    public Mesh ToMesh(int nu, int nv, double angle, ref List<Point3d> fixedPoints, ref List<LineCurve> listUCurves, ref List<LineCurve> listVCurves, double deviation, bool zbool)
    {
      List < Point3d > pts1 = new  List < Point3d >();
      List < Point3d > pts2 = new  List < Point3d >();

      if (side1.isEnd)
      {
        pts1 = ToArcDeviation(side1.point, new Vector3d(side2.point - side1.point), side1.direction, angle, nv, deviation, zbool);
        fixedPoints.AddRange(pts1);
      }
      else
      {
        //pts1 = ToLine(side1.point, side1.direction, nv, angle, radius, zbool);
        pts1 = ToLine(side1.point, side1.direction, nv, angle, side1.width, zbool);
      }


      if (side2.isEnd)
      {
        pts2 = ToArcDeviation(side2.point, new Vector3d(side1.point - side2.point), side2.direction, angle, nv, deviation, zbool);
        fixedPoints.AddRange(pts2);
      }
      else
      {
        //pts2 = ToLine(side2.point, side2.direction, nv, angle, radius, zbool);
        pts2 = ToLine(side2.point, side2.direction, nv, angle, side2.width, zbool);
      }

      return PointsToMesh(pts1, pts2, nu, ref listUCurves, ref  listVCurves);
    }

    //With DATATREE
    // public Mesh ToMesh(int nu, int nv, double angle, double radius, ref List<Point3d> fixedPoints, ref DataTree<LineCurve> listUCurves, ref DataTree<LineCurve> listVCurves, double deviation, bool zbool)
    public Mesh ToMesh(int nu, int nv, double angle, ref List<Point3d> fixedPoints, ref DataTree<LineCurve> listUCurves, ref DataTree<LineCurve> listVCurves, double deviation, bool zbool)
    {
      List < Point3d > pts1 = new  List < Point3d >();
      List < Point3d > pts2 = new  List < Point3d >();

      if (side1.isEnd)
      {
        pts1 = ToArcDeviation(side1.point, new Vector3d(side2.point - side1.point), side1.direction, angle, nv, deviation, zbool);
        fixedPoints.AddRange(pts1);
      }
      else
      {
        //pts1 = ToLine(side1.point, side1.direction, nv, angle, radius, zbool);
        pts1 = ToLine(side1.point, side1.direction, nv, angle, side1.width, zbool);
      }

      if (side2.isEnd)
      {
        pts2 = ToArcDeviation(side2.point, new Vector3d(side1.point - side2.point), side2.direction, angle, nv, deviation, zbool);
        fixedPoints.AddRange(pts2);
      }
      else
      {
        //pts2 = ToLine(side2.point, side2.direction, nv, angle, radius, zbool);
        pts2 = ToLine(side2.point, side2.direction, nv, angle, side2.width, zbool);
      }

      return PointsToMesh(pts1, pts2, nu, ref listUCurves, ref  listVCurves);
    }


    public LDPanel(LDSide s1, LDSide s2, int line)
    {
      side1 = s1;
      side2 = s2;
      lineNumber = line;
    }
    public bool Touch(LDPanel other)
    {
      bool output = false;
      Vector3d vect = new Vector3d();
      if (other.side1.nodeNumber == side1.nodeNumber)
      {
        vect = other.side1.direction - side1.direction;
        if (vect.Length < 0.001) output = true;
      }

      if (other.side2.nodeNumber == side1.nodeNumber)
      {
        vect = other.side2.direction - side1.direction;
        if (vect.Length < 0.001) output = true;
      }

      if (other.side1.nodeNumber == side2.nodeNumber)
      {
        vect = other.side1.direction - side2.direction;
        if (vect.Length < 0.001) output = true;
      }

      if (other.side2.nodeNumber == side2.nodeNumber)
      {
        vect = other.side2.direction - side2.direction;
        if (vect.Length < 0.001) output = true;
      }

      return output;
    }



  }
  public static  List<LDPanel> GetIntersections(List < LDPanel > lines, List<LDPanel> source)
  {
    List<LDPanel> output = new List<LDPanel>();

    for (int i = 0; i < lines.Count; i++)
    {
      for (int j = 0; j < source.Count; j++)
      {
        if (lines[i].Touch(source[j]))
        {
          bool test = true;
          for (int k = 0; k < output.Count; k++)
          {
            if (source[j].lineNumber == output[k].lineNumber) test = false;
          }
          if (test) output.Add(source[j]);
        }
      }
    }
    return output;
  }
  public class LDSide
  {
    public int nodeNumber;
    public Point3d point;
    public Vector3d direction;
    public bool isEnd;
    public double width;

    public LDSide()
    {
      nodeNumber = -1;
      point = new Point3d(Point3d.Unset);
      direction = new Vector3d(Vector3d.Unset);
      isEnd = true;
    }

    public LDSide(LDSide side)
    {
      LDSideSet(side.nodeNumber, side.point, side.direction, side.isEnd, side.width);
    }
    public LDSide(int n, Point3d pt, Vector3d dir, bool end, double width_calc)
    {
      nodeNumber = n;
      point = new Point3d(pt);
      direction = new Vector3d(dir);
      isEnd = end;
      width = width_calc;
    }
    public void LDSideSet(int n, Point3d pt, Vector3d dir, bool end, double width_calc)
    {
      nodeNumber = n;
      point = new Point3d(pt);
      direction = new Vector3d(dir);
      isEnd = end;
      width = width_calc;
    }
    public Curve ToCurve()
    {
      return new LineCurve(point, (Point3d) (point + direction));
    }
  }
  /////////////////////////////////////////////////////
  public static List<Point3d> ToArc(Point3d zero, Vector3d x, Vector3d y, double angle, int n, bool zbool)
  {
    List<Point3d> output = new List<Point3d>();

    Vector3d x_unit = new Vector3d(x);
    x_unit.Unitize();
    if (zbool) x_unit = Vector3d.ZAxis;

    Vector3d y_unit = new Vector3d(y);
    y_unit.Unitize();

    double width = y.Length;
    double angle0 = 0.0;

    if (Math.Abs(angle) < 0.01)
    {
      for (int i = 0; i < n; i++)
      {
        angle0 = angle * (double) i / (double) (n - 1);
        Vector3d x1 = x_unit * ( width * angle0);
        Vector3d y1 = y_unit * width * (double) i / (double) (n - 1);
        output.Add(new Point3d(zero + x1 + y1));
      }
    }
    else
    {
      for (int i = 0; i < n; i++)
      {
        angle0 = angle * (double) i / (double) (n - 1);
        Vector3d x1 = x_unit * ( width / Math.Sin(angle) * (1.0 - Math.Cos(angle0)));
        Vector3d y1 = y_unit * ( width * Math.Sin(angle0) / Math.Sin(angle));
        output.Add(new Point3d(zero + x1 + y1));
      }
    }
    return output;
  }
  /////////////////////////////////////////////////////
  public static List<Point3d> ToArcDeviation(Point3d zero, Vector3d x, Vector3d y, double angle, int n, double maxDeviation, bool zbool)
  {
    List<Point3d> output = new List<Point3d>();
    Vector3d x_unit = new Vector3d(x);
    x_unit.Unitize();
    if (zbool) x_unit = Vector3d.ZAxis;

    Vector3d y_unit = new Vector3d(y);
    y_unit.Unitize();

    double width = y.Length;
    double angle0 = 0.0;
    double deviation = 1.2;
    if (Math.Abs(angle) < 0.01)
    {
      for (int i = 0; i < n; i++)
      {
        deviation = ((double) i % 2.0) * maxDeviation;
        angle0 = angle * (double) i / (double) (n - 1);
        Vector3d x1 = x_unit * (deviation * width * angle0);
        Vector3d y1 = y_unit * width * (double) i / (double) (n - 1);
        output.Add(new Point3d(zero + x1 + y1));
      }
    }
    else
    {
      double angle_max;
      if (angle > Math.PI / 2)
      {
        angle_max = Math.PI / 2;
      }
      else
      {
        if (angle < -Math.PI / 2) angle_max = -Math.PI / 2;
        else angle_max = angle;
      }

      for (int i = 0; i < n; i++)
      {
        deviation = ((double) i % 2.0) * maxDeviation;
        angle0 = angle * (double) i / (double) (n - 1);
        Vector3d x1 = x_unit * (width / Math.Sin(angle_max) * (1.0 - Math.Cos(angle0)) - deviation * Math.Cos(angle0));
        Vector3d y1 = y_unit * ( width / Math.Sin(angle_max) + deviation) * Math.Sin(angle0);
        output.Add(new Point3d(zero + x1 + y1));
      }
    }
    return output;
  }
  /////////////////////////////////////////////////////
  public static List<Point3d> ToLine(Point3d zero, Vector3d y, int n, double angle0, double radius, bool zbool)
  {
    List<Point3d> output = new List<Point3d>();
    if (zbool)
    {
      double angle;
      //y.Unitize();
      Vector3d z = Vector3d.ZAxis;

      for (int i = 0; i < n; i++)
      {
        angle = Math.Abs(angle0) * (double) i / (double) (n - 1);
        output.Add(new Point3d(zero + y * Math.Sin(angle) + z * Math.Sign(angle0) * radius * (1 - Math.Cos(angle))));
      }

    }
    else
    {
      for (int i = 0; i < n; i++)
      {
        output.Add(new Point3d(zero + y * (double) i / (double) (n - 1)));
      }
    }
    return output;

    //return ToArc(zero, new Vector3d(0.0, 0.0, 0.0), y, angle, n, zbool);
  }
  /////////////////////////////////////////////////////
  public static Mesh PointsToMesh(List < Point3d > pts1, List<Point3d> pts2, int nx, ref List<LineCurve> listUCurves, ref List<LineCurve> listVCurves)
  {
    int ny = pts1.Count;

    Rhino.Geometry.Mesh mesh = new Rhino.Geometry.Mesh();

    for (int iy = 0; iy < ny; iy++)
    {
      for (int ix = 0; ix < nx; ix++)
      {

        mesh.Vertices.Add(new Point3d(pts1[iy] + (pts2[iy] - pts1[iy]) * (double) ix / (double) (nx - 1)));
      }
    }
    int i0, i1, i2, i3;
    for (int ix = 0; ix < (nx - 1); ix++)
    {
      for (int iy = 0; iy < (ny - 1); iy++)
      {
        i0 = ix + iy * nx;
        i1 = (ix + 1) + iy * nx;
        i2 = (ix + 1) + (iy + 1) * nx;
        i3 = ix + (iy + 1) * nx;
        mesh.Faces.AddFace(i0, i1, i2, i3);
        listUCurves.Add(new LineCurve(mesh.Vertices[i0], mesh.Vertices[i1]));
        listVCurves.Add(new LineCurve(mesh.Vertices[i1], mesh.Vertices[i2]));
        listUCurves.Add(new LineCurve(mesh.Vertices[i2], mesh.Vertices[i3]));
        listVCurves.Add(new LineCurve(mesh.Vertices[i3], mesh.Vertices[i0]));
      }
    }
    mesh.Normals.ComputeNormals();
    mesh.Compact();
    return mesh;
  }
  /////////////////////////////////////////////////////
  public static Mesh PointsToMesh(List < Point3d > pts1, List<Point3d> pts2, int nx, ref DataTree<LineCurve> listUCurves, ref DataTree<LineCurve> listVCurves)
  {
    int ny = pts1.Count;

    Rhino.Geometry.Mesh mesh = new Rhino.Geometry.Mesh();

    for (int iy = 0; iy < ny; iy++)
    {
      for (int ix = 0; ix < nx; ix++)
      {

        mesh.Vertices.Add(new Point3d(pts1[iy] + (pts2[iy] - pts1[iy]) * (double) ix / (double) (nx - 1)));
      }
    }
    int i0, i1, i2, i3;
    for (int ix = 0; ix < (nx - 1); ix++)
    {
      for (int iy = 0; iy < (ny - 1); iy++)
      {
        i0 = ix + iy * nx;
        i1 = (ix + 1) + iy * nx;
        i2 = (ix + 1) + (iy + 1) * nx;
        i3 = ix + (iy + 1) * nx;
        mesh.Faces.AddFace(i0, i1, i2, i3);
        listUCurves.Add(new LineCurve(mesh.Vertices[i0], mesh.Vertices[i1]), new GH_Path(iy));
        listVCurves.Add(new LineCurve(mesh.Vertices[i1], mesh.Vertices[i2]), new GH_Path(iy));
        listUCurves.Add(new LineCurve(mesh.Vertices[i2], mesh.Vertices[i3]), new GH_Path(iy + 1));
        listVCurves.Add(new LineCurve(mesh.Vertices[i3], mesh.Vertices[i0]), new GH_Path(iy));
      }
    }
    mesh.Normals.ComputeNormals();
    mesh.Compact();
    return mesh;
  }
# ---------- end c_script_2 ----------
mesh_2 = Mesh(flatten(c_script_2.M))
mjoin = MeshJoin(Meshes=mesh_2)
weldvertices = MeshWeldVertices(Mesh=mjoin, Tolerance=0.1)  # -> RuntimeMessage, Mesh
wbcatmullclark_2 = WeaverbirdsCatmullClarkSubdivision(MeshCurves=weldvertices.Mesh, Level=3, SmoothNakedEdges=1)

# ----
project = Project(Geometry=wbcatmullclark_2, Plane=PlaneXY(0, 0, 0))  # -> Geometry, Transform
wbnaked = WeaverbirdsNakedBoundary(MeshClosedPolylines=project.Geometry)
wbedges = WeaverbirdsMeshEdges(MeshOrPolylines=project.Geometry)
boundary_2 = BoundarySurfaces(Edges=wbnaked)
merge_23 = Merge(Data1=boundary_2, Data2=lines)  # -> flatten(Result)
dispatch_5 = Dispatch(List=merge_23, DispatchPattern=values_7.Values)  # -> ListA, ListB
geo_10 = Geometry(dispatch_5.ListB)
edges_3 = BrepEdges(Brep=boundary_2)  # -> Naked, Interior, NonManifold
crv_28 = Curve(edges_3.Naked)
join_3 = JoinCurves(Curves=crv_28, Preserve=False)
reb = RebuildCurve(Curve=join_3, Degree=3, Count=Slider(300, range=0..1000), Tangents=False)
srf_15 = Surface(reb)
dispatch_6 = Dispatch(List=srf_15, DispatchPattern=values_7.Values)  # -> ListA, ListB
geo_11 = Geometry(dispatch_6.ListB)
edges_4 = BrepEdges(Brep=srf_15)  # -> Naked, Interior, NonManifold
crv_29 = Curve(edges_4.Naked)
join_4 = JoinCurves(Curves=crv_29, Preserve=False)
crv_30 = Curve(join_4)
srf_16 = Surface(crv_30)
gate_8 = StreamGate(Stream=srf_16, Gate=values.Values)  # -> Target0, Target1
srf_17 = Surface(gate_8.Target1)
bake_10 = BakeGeometry(Bake=values_18.Values, Geometry=crv_30, Attributes=createatts, DeleteOldBakes=False, PreserveTrees=False)
area_5 = Area(Geometry=join_4)  # -> Area, Centroid
cir_3 = Circle(Plane=area_5.Centroid, Radius=Slider(4, range=0..10))
divide_3 = DivideCurve(Curve=cir_3, Count=10, Kinks=False)  # -> Points, Tangents, Parameters
